# Grasshopper definition 013_WICKERSON.gh (Grasshopper 1.0.7)

# Wickerson's Favorite .gh Scripts
# from WICKERSON
number_slider = Slider(14, range=0..100)
# Range in Set/Sequence
# Points
# Sine and Cosine
# Spline instead of Line
number_slider_2 = Slider(100, range=0..100)
range = Range(Domain=number_slider, Steps=number_slider_2)
sin = Sine(Value=range)
cos = Cosine(Value=range)
pt = ConstructPoint(XCoordinate=range, YCoordinate=sin, ZCoordinate=cos)
nurbs = NurbsCurve(Vertices=pt, Degree=3, Periodic=False)  # -> Curve, Length, Domain
